# Grasshopper definition Grasshopper Turning torso.gh (Grasshopper 1.0.8)
# plug-ins: RhinoCodePluginGH

# ----
# Automated Input Iteration
# (Python)
trigger = Trigger(Interval=500, TimerInterval=500, Target=python_3_script)  # disabled
trigger_2 = BooleanToggle(True)
python_3_script = Python3Script(trigger=trigger_2)  # -> rotation, city, NoFloor, L1
# ---------- python_3_script: Python ----------
import itertools
import time

# Only run when triggered
if not trigger:
    L1 = NoFloor = rotation = city = None
else:
    # All possible values
    L1_vals = list(range(22, 24))
    NoFloor_vals = list(range(5, 56, 5))
    rotation_vals = list(range(0, 12))
    city_vals = list(range(0, 4))

    # Make combinations only once
    if 'all_combinations' not in globals():
        all_combinations = list(itertools.product(L1_vals, NoFloor_vals, rotation_vals, city_vals))
        i = 0

    # Get the current combination
    if i < len(all_combinations):
        L1, NoFloor, rotation, city = all_combinations[i]
        ghenv.Component.Message = f"Running {i+1}/{len(all_combinations)}"
        i += 1
        time.sleep(1.5)  # Give time for model to update
    else:
        ghenv.Component.Message = "Finished all combinations"
        L1 = NoFloor = rotation = city = None
# ---------- end python_3_script ----------

l1 = Slider(17, range=16..23)
rotation = Slider(6, range=0..11)
nofloor = Slider(55, range=1..55)
city = Slider(0, range=0..4)

nofloor_2 = Number(python_3_script.NoFloor)
city_2 = Number(python_3_script.city)
# Main Model Input
l1_2 = Number(python_3_script.L1)
rotation_2 = Number(python_3_script.rotation)
panel = Panel(l1_2)
panel_2 = Panel(city_2)
panel_3 = Panel(rotation_2)
panel_4 = Panel(nofloor_2)

# ----
# Finiding L2 base on L1
# bottom Horz 'L1' edge
evaluate = Evaluate(Expression="(120-3*L1)/2", L1=l1_2)
panel_5 = Panel(evaluate)
l2 = Number(panel_5)

image_resource = ImageResource("D:\Polimi\1st Semester\SCIENTIFIC COMPUTING FOR BUILDING ENGINEERING (PAGANI STEFANO)\call first of september\Uploaded Super Final\final\Uploaded Super Final\call septemer\gh Guide Pic (keep it next to the gh. file).jpg")

unit_x = UnitX(Factor=1)
construct_point = ConstructPoint(XCoordinate=Slider(0, range=0..500), YCoordinate=Slider(0, range=0..500), ZCoordinate=Slider(0, range=0..100))
line1 = LineSDL(Start=construct_point, Direction=unit_x, Length=l1_2)

# ----
# EPW Zip files
malmö = Panel("https://climate.onebuilding.org/WMO_Region_6_Europe/SWE_Sweden/SN_Skane/SWE_SN_Malmo.026350_TMYx.zip")
barcellona = Panel("https://climate.onebuilding.org/WMO_Region_6_Europe/ESP_Spain/CT_Catalonia/ESP_CT_Barcelona-El.Prat.AP.081810_TMYx.2009-2023.zip")
milano = Panel("https://climate.onebuilding.org/WMO_Region_6_Europe/ITA_Italy/LM_Lombardy/ITA_LM_Milano-Malpensa.AP.160660_TMYx.2009-2023.zip")
berlin = Panel("https://climate.onebuilding.org/WMO_Region_6_Europe/DEU_Germany/BE_Berlin/DEU_BE_Berlin-Schonefeld.AP.103850_TMYx.2009-2023.zip")

end_points = EndPoints(Curve=line1)  # -> Start, End

# ---- group: a
x = Slider(122, range=0..1000)
expression = Expression(x=x, Expression="(x*π)/180")
panel_6 = Panel(expression)
# Left 'L1' Edge
unit_x_2 = UnitX(Factor=1)
unit_z = UnitZ(Factor=1)
rotate = Rotate(Vector=unit_x_2, Axis=unit_z, Angle=panel_6)
line_2 = LineSDL(Start=end_points.Start, Direction=rotate, Length=l1_2)

x_2 = Slider(58, range=0..1000)
expression_2 = Expression(x=x_2, Expression="(x*π)/180")
panel_7 = Panel(expression_2)
unit_x_3 = UnitX(Factor=1)
unit_z_2 = UnitZ(Factor=1)
# Right 'L1' Edge
rotate_2 = Rotate(Vector=unit_x_3, Axis=unit_z_2, Angle=panel_7)
line_3 = LineSDL(Start=end_points.End, Direction=rotate_2, Length=l1_2)

# ----
merge = Merge(Data1=malmö, Data2=milano, Data3=barcellona, Data4=berlin)

# ----
# Top Vertex
# (Python)
python_3_script_2 = Python3Script(start=end_points.Start, end=end_points.End, L1=l1_2, L2=l2)  # -> mid_point
# ---------- python_3_script_2: Python ----------
import rhinoscriptsyntax as rs
import Rhino.Geometry as rg
import math

# Convert Rhino GUIDs to Point3d
start_pt = rs.coerce3dpoint(start)
end_pt = rs.coerce3dpoint(end)

# Midpoint X and Z stay the same
mid_x = (start_pt.X + end_pt.X) / 2
mid_z = start_pt.Z

# Angles in degrees → radians
angle32 = math.radians(32)
angle58 = math.radians(58)

# Part inside the sqrt
part_inside = L1 * (0.5 + math.sin(angle32))
under_root = L2**2 - part_inside**2

# Compute offset safely
if under_root >= 0:
    sqrt_part = math.sqrt(under_root)
else:
    sqrt_part = 0  # prevent error

# New Y = (L1*sin(58)) + sqrt(...)
mid_y = (L1*math.sin(angle58)) + sqrt_part

# Final midpoint
mid_point = rg.Point3d(mid_x, mid_y, mid_z)
# ---------- end python_3_script_2 ----------
point = Point(python_3_script_2)

list_item = ListItem(List=merge, Index=city_2, Wrap=True)

# ---- group: Rotation
number_slider = Slider(10, range=10..135)
number_slider_2 = Slider(10, range=1..10)
expression_3 = Expression(x=number_slider, y=Slider(120, range=27..225), z=number_slider_2, Expression="(y-x)/z+1")
# Total and each floor Rotation
series = Series(Start=number_slider, Step=number_slider_2, Count=expression_3)
panel_8 = Panel(expression_3)
# Total rotation
panel_9 = Panel(series)
division = Division(A=panel_9, B=Slider(54, range=0..100))
# Rotation of each floor
renameplz = Panel(division)
list_item_2 = ListItem(List=renameplz, Index=rotation_2, Wrap=True)
panel_10 = Panel(list_item_2)

# ---- group: EPW
panel_11 = Panel(list_item)
downloadepw = LBDownloadWeather(weather_URL=panel_11)  # -> epw_file, stat_file, ddy_file; plug-in component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
importepw = LBImportEPW(epw_file=downloadepw.epw_file)  # -> location, dry_bulb_temperature, dew_point_temperature, relative_humidity, wind_speed, wind_direction, direct_normal_rad, diffuse_horizontal_rad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; plug-in component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

# ----
# Right 'L2' Edge
end_points_2 = EndPoints(Curve=line_3)  # -> Start, End
line_4 = Line(StartPoint=end_points_2.End, EndPoint=point)

# ----
# Left 'L2' Edge
end_points_3 = EndPoints(Curve=line_2)  # -> Start, End
line_5 = Line(StartPoint=end_points_3.End, EndPoint=point)

# ---- group: Period
analysisperiod = LBAnalysisPeriod(
    start_month=Slider(12, range=1..12),
    start_day=Slider(21, range=1..31),
    start_hour=Slider(1, range=1..24),
    end_month=Slider(12, range=1..12),
    end_day=Slider(21, range=1..31),
    end_hour=Slider(23, range=1..24))  # -> period, hoys, dates; plug-in component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

# ----
# Sky Dome, Sun path, Radiation and Sun status
# Date: 21th Dec
point_2 = Point(Point(9, 18, 0))
# Contex
# (can be hidden)
contex = Geometry([<extrusion referenced from the Rhino model> x114, <mesh referenced from the Rhino model>])

# ----
# Base Surface Geometry
merge_2 = Merge(Data1=line_5, Data2=line_3, Data3=line_4, Data4=line_2, Data5=line1)

# ---- group: Benefit Matrix
benefitmatrix = LBBenefitSkyMatrix(
    location=importepw.location,
    temperature=importepw.dry_bulb_temperature,
    direct_rad=importepw.direct_normal_rad,
    diffuse_rad=importepw.diffuse_horizontal_rad,
    hoys=analysisperiod.hoys)  # -> out, sky_mtx; plug-in component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
skydome = LBSkyDome(sky_mtx=benefitmatrix.sky_mtx, center_pt=point_2, scale=Slider(2.384, range=0..5), irradiance=Toggle(False))  # -> out, mesh, compass, legend, title, patch_vecs, patch_values, mesh_values, vis_set; plug-in component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

# ---- group: Sun Path
point_3 = Point(Point(0, 0, 0))
sunpath = LBSunPath(
    location=importepw.location,
    hoys=analysisperiod.hoys,
    center_pt=point_3,
    scale=Slider(3, range=0..100),
    data=importepw.dry_bulb_temperature)  # -> out, vectors, altitudes, azimuths, hoys, sun_pts, analemma, daily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; plug-in component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
custom_preview = CustomPreview(Geometry=sunpath.analemma, Material=ColourSwatch(SwatchColor=RGB(255, 255, 0)))
custom_preview_2 = CustomPreview(Geometry=sunpath.compass, Material=ColourSwatch(SwatchColor=RGB(0, 0, 0)))

# ----
boundary_surfaces = BoundarySurfaces(Edges=merge_2)
surface = Surface(boundary_surfaces)

# ---- group: Sky Matrix
skymatrix = LBCumulativeSkyMatrix(
    location=importepw.location,
    direct_rad=importepw.direct_normal_rad,
    diffuse_rad=importepw.diffuse_horizontal_rad,
    hoys=analysisperiod.hoys)  # -> out, sky_mtx; plug-in component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
radrose = LBRadiationRose(
    sky_mtx=skymatrix.sky_mtx,
    context=flatten(contex),
    center_pt=point_2,
    scale=Slider(1, range=0..10),
    arrow_scale=1,
    irradiance=Toggle(False))  # -> out, mesh, compass, orient_lines, legend, title, dir_vecs, dir_values, vis_set; plug-in component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
skydome_2 = LBSkyDome(sky_mtx=skymatrix.sky_mtx, center_pt=point_2, scale=Slider(2, range=0..10), irradiance=Toggle(False))  # -> out, mesh, compass, legend, title, patch_vecs, patch_values, mesh_values, vis_set; plug-in component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

# ----
series_2 = Series(Start=Slider(0, range=0..2.5), Step=panel_10, Count=nofloor_2)

radiationdome = LBRadiationDome(
    sky_mtx=benefitmatrix.sky_mtx,
    context=flatten(contex),
    center_pt=point_2,
    scale=Slider(2, range=0..10),
    irradiance=Toggle(False))  # -> out, mesh, compass, legend, title, dir_vecs, dir_values, max_pt, max_info, vis_set; plug-in component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

radrose_2 = LBRadiationRose(
    sky_mtx=benefitmatrix.sky_mtx,
    context=flatten(contex),
    center_pt=point_2,
    scale=Slider(2, range=0..10),
    arrow_scale=1,
    irradiance=Toggle(False))  # -> out, mesh, compass, orient_lines, legend, title, dir_vecs, dir_values, vis_set; plug-in component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

# ---- group: Main Model
series_3 = Series(Start=Slider(0, range=0..100), Step=Slider(4, range=0..10), Count=nofloor_2)
unit_z_3 = UnitZ(Factor=series_3)
# Model Volume
move = Move(Geometry=surface, Motion=unit_z_3)  # -> Geometry, Transform
area = Area(Geometry=move.Geometry)  # -> Area, Centroid
rotate_3 = Rotate(Geometry=move.Geometry, Angle=degrees(series_2), Plane=area.Centroid)  # -> Geometry, Transform
partition_list = PartitionList(List=rotate_3.Geometry, Size=Slider(5, range=0..10))
loft = Loft(Curves=partition_list, Options={Adjust=False, Closed=False, LoftEnds=0, LoftSimp=0, LoftType=0, Rebuild=10, Refit=0.01})
cap_holes = CapHoles(Brep=loft)

# ----
# Total Incident Irradiation on the surface
mesh = Mesh(cap_holes)

# ---- group: Direct Sun Hours
directsunhours = LBDirectSunHours(
    vectors=flatten(sunpath.vectors),
    geometry=flatten(mesh),
    context=flatten(contex),
    grid_size=Slider(1, range=0..1),
    run=Toggle(False))  # -> out, points, results, mesh, legend, title, int_mtx; plug-in component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

# ---- group: Irradiation [kWh]
incidentradiation = LBIncidentRadiation(sky_mtx=skymatrix.sky_mtx, geometry=flatten(mesh), grid_size=Slider(1, range=0..10), run=Toggle(True))  # -> out, points, results, total, mesh, legend, title, int_mtx; plug-in component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
mesh_2 = Mesh(incidentradiation.mesh)
panel_12 = Panel(incidentradiation.total)

# ---- group: Surface Area
area_2 = Area(Geometry=cap_holes)  # -> Area, Centroid
# Surface Area
mass_addition = MassAddition(Input=flatten(area_2.Area))  # -> Result, PartialResults
panel_13 = Panel(mass_addition.Result)

# ----
area_3 = Number(panel_13)
irradiation = Number(panel_12)

# ----
# Recorder of all the
# inputs and results as CSV (Python)
python_3_script_3 = Python3Script(L1=l1_2, NoFloor=nofloor_2, rotation=rotation_2, city=city_2, area=area_3, irradiation=irradiation, trigger=trigger_2)  # -> a
# ---------- python_3_script_3: Python ----------
import csv
import os
import scriptcontext as sc

# Try to get the Grasshopper file path
gh_path = sc.sticky["ghfile_path"] if "ghfile_path" in sc.sticky else None

# If it's not cached, try to fetch it once from ghdoc
if not gh_path:
    try:
        gh_path = ghdoc.Path
        if gh_path:
            gh_path = os.path.dirname(gh_path)
            sc.sticky["ghfile_path"] = gh_path  # Cache it
    except:
        gh_path = None

# Default to Desktop if Grasshopper path isn't found
if not gh_path:
    gh_path = os.path.join(os.path.expanduser("~"), "Desktop")

# Final CSV file path
filename = "turning_torso_data.csv"
filepath = os.path.join(gh_path, filename)

# Create folder if needed
os.makedirs(gh_path, exist_ok=True)

# Prepare row
row = [L1, NoFloor, rotation, city, irradiation, area]

# Write row if triggered
if trigger:
    write_headers = not os.path.exists(filepath)
    with open(filepath, mode='a', newline='') as file:
        writer = csv.writer(file)
        if write_headers:
            writer.writerow(["L1", "NoFloor", "rotation", "city", "irradiation", "area"])
        writer.writerow(row)
# ---------- end python_3_script_3 ----------
panel_14 = Panel(python_3_script_3)
